vi "Channel Estimation.gvi"   [LabVIEW Communications System Design Suite 2.0.1]
inputs:
  "Rx signal": c128[]
  "Preamble": c128[]
  "Channel Length": i32
  "preamble FFT size": i32 = -1
  "index": i32  # Index of the preamble starting point
  "data FFT size": i32 = -1
outputs:
  "Channel Freq. Resp.": c128[]
uses:
  NI::Analysis::Transforms::Complex FFT.gvi
  NI::Analysis::Transforms::Inverse Complex FFT.gvi
diagram:
  Array Subset(array=$"Rx signal", index0=$index, length0=$"preamble FFT size") -> w1
  call "Complex FFT.gvi"(x=w1, FFT size=$"preamble FFT size") -> (FFT{x}=w2)
  call "Complex FFT.gvi"(x=$Preamble, FFT size=$"preamble FFT size") -> (FFT{x}=w3)
  Reciprocal(x=w3) -> w4
  for {
    w5 = each element of w2
    w6 = each element of w4
    Multiply(w5, w6) -> w8
    append w8 to w7
  }
  call "Inverse Complex FFT.gvi"(FFT{x}=w7) -> (x=w9)
  Array Size(array=w9) -> (size(s)=w10)
  Subtract(x=w10, y=$"Channel Length") -> w11
  Array Subset(array=w9, index0=w11, length0=$"Channel Length") -> w12
  Initialize Array(element=0+0i, size=$"data FFT size") -> w13
  Array Subset(array=w9, index0=0, length0=$"Channel Length") -> w14
  Replace Array Subset(inArray=w13, index=0, new=w14) -> w15
  Subtract(x=$"data FFT size", y=$"Channel Length") -> w16
  Replace Array Subset(inArray=w15, index=w16, new=w12) -> w17
  call "Complex FFT.gvi"(x=w17, FFT size=$"data FFT size") -> (FFT{x}=w18)
  Add($index, $"preamble FFT size") -> w19
  Array Subset(array=$"Rx signal", index0=w19, length0=$"preamble FFT size") -> w20
  call "Complex FFT.gvi"(x=w20, FFT size=$"preamble FFT size") -> (FFT{x}=w21)
  call "Complex FFT.gvi"(x=$Preamble, FFT size=$"preamble FFT size") -> (FFT{x}=w22)
  Reciprocal(x=w22) -> w23
  for {
    w24 = each element of w21
    w25 = each element of w23
    Multiply(w24, w25) -> w27
    append w27 to w26
  }
  call "Inverse Complex FFT.gvi"(FFT{x}=w26) -> (x=w28)
  Array Size(array=w28) -> (size(s)=w29)
  Subtract(x=w29, y=$"Channel Length") -> w30
  Array Subset(array=w28, index0=w30, length0=$"Channel Length") -> w31
  Initialize Array(element=0+0i, size=$"data FFT size") -> w32
  Array Subset(array=w28, index0=0, length0=$"Channel Length") -> w33
  Replace Array Subset(inArray=w32, index=0, new=w33) -> w34
  Subtract(x=$"data FFT size", y=$"Channel Length") -> w35
  Replace Array Subset(inArray=w34, index=w35, new=w31) -> w36
  call "Complex FFT.gvi"(x=w36, FFT size=$"data FFT size") -> (FFT{x}=w37)
  Add(w18, w37) -> w38
  Reciprocal(x=2+0i) -> w39
  for {
    w40 = each element of w38
    Multiply(w40, w39) -> w42
    append w42 to w41
  }
  $"Channel Freq. Resp." <- w41
