vi "GFDM Host.gvi"   [LabVIEW Communications System Design Suite 2.0.1]
panel controls:
  "stop": bool = TRUE
  "GFDM parameter": "GFDM parameter.gtype" = {"Variable: K"=64, "Variable: M"=9, "Variable: a"=0, "filter type"="rc", "receive filter"="ZF", "inverse FFT"=FALSE, "Variable: b"=0, "Ncs"=16, "Ncp"=32}
  "Operation": i32
  "TX.modem.bitshift_in": i16 = 11
  "USRP RIO device": string = "RIO0"
  "Reference Frequency Source": string = "Internal"
  "RX.switch channels": bool
  "Channel Length": i32 = 10
  "RX.modem.bitshift_in": i16 = 16
  "RX.modem.fft.bitshift_in": i16 = 16
  "UDP receive port": u16 = 8888
  "RX.enable": bool = TRUE
  "TX.modem.transmission time interval": u64
  "TX.enabled": bool = TRUE
  "Control Tab": i32
  "UART.control": T9 = {"txEnable"=TRUE, "rxEnable"=TRUE, "Reset"=FALSE, "baud_count"=200, "reset frame counter"=FALSE, "reset tx counter"=FALSE, "reset rx counter"=FALSE}
  "UDP send port": u16 = 8888
  "PayloadSize [Byte]": u16 = 36
  "Use Phase Tracking": bool = TRUE
  "DataRouting_FPGA": T12 = "Data from Host"
  "Add frame counter": bool = TRUE
  "RM:No DC": bool = TRUE
  "TX.Sample Rate [S/s]": f64 = 30000000
  "RX.Frequency [Hz]": f64 = 3780000000
  "TX.Frequency [Hz]": f64 = 3720000000
  "RX.Sample Rate [S/s]": f64 = 30000000
  "UseCAPIData": bool
  "Fully allocated?": bool = TRUE
  "RX.sync.config": T14 = {"CFO removal"=FALSE, "ffoPiControlCte"=9.91821289062e-05, "Pi Control"=0.100006103516, "Analog Gain Controller"=TRUE, "setpoint (max. amplitude)"=0.700042724609, "numbOfBlocksBeforGainChange"=5, "Digital Gain Controller"=FALSE, " Gain [dB]"=25, "permissible error [dB]"=1}
  "normalize preamble?": bool = TRUE
  "ATR.config": T16 = {"set"=FALSE, "lo lpf"=FALSE, "cpld "=FALSE, "switchChannel"=FALSE, "Destination"="configTx", "antenna configuration"="TX1 RX1 transmits and RX2 receives", "daughterboard"="ubx", "GainIn"=10, "spi address"=7}
  "TX.sync.debugOut": bool
  "RX.sync.preambleOutFifoActive": bool = TRUE
  "syncDataOutGraphLength": u32 = 10000
  "shiftFactorReciprocal": i16 = -1
  "AGC.disableAGC": bool
  "TX.switch Channel": bool
  "QAM order": enum{"4-QAM", "16-QAM", "64-QAM", "256-QAM"} = "4-QAM"
  "data type": bool
  "enable CRC?": bool
  "microseconds to wait": u32
  "numbOfFramesToDisplay": u32 = 4
  "all symbols out": bool
  "init TX Power [dBm]": f64 = 5
  "init RX Power [dBm]": f64
  "DataType_Host": T17 = "UDP or generate over queue"
  "simulate UDP": bool
  "repeat options": T18 = "do not repeat"
  "create dummy data": bool
  "microseconds to wait dummy data": u32 = 100000
  "data type_dymmy": bool = TRUE
  "EvaluateDebugData": bool
  "readDebbugData": bool
  "UDP send address": string = "10.0.1.2"
  "network update interval [ms]": u32 = 2000
  "max number of packets": i32 = 3
  "TestMan broadcasts": bool = TRUE
  "TestManConfig in": T19 = {"port"=50000, "ip"="224.5.6.7", "connection"=refnum, "type"=123, "id"=123}
  "latency measurment timeout [ms]_in": u32 = 20
  "repeat every [ms]": u32 = 200
  "Measurement active_in": bool = TRUE
  "TX.modem.input shift_in": i16 = 6
  "RX.forward broken crc": bool
  "TX.Nsleep-3 (min.2)": u32 = 1000
  "TX.akivateRepeatiotion": bool
  "RX.forward repeated crc": bool
panel indicators:
  "general error description": string  # source out indicates the source of the error.
  "rx.number of overflows": u32
  "rx.output sample rate": UFXP(1.47)
  "rx 0.number of IQ data overflows": u64
  "rx.samples processed": u32
  "rx.samples to acquire": u32
  "rx.state": enum{"Idle", "Active"}
  "tx 0.number of IQ data overflows": u64
  "rx 1.number of IQ data overflows": u64
  "tx 1.number of IQ data overflows": u64
  "tx.input sample rate": UFXP(1.47)
  "TX.modem.DEBUG.cluster_out": T4
  "tx.RF.state": enum{"Idle", "Active"}
  "tx.underflows": u32
  "TX Coerced Configurations": T5
  "RX Coerced Configurations": T6
  "RX.sync.sync found_out": u32
  "debugGraphSync": f64[][]
  "FPGA configuration": T7
  "RX.sync.GFDM configuration cluster": T8
  "channel freq domain": f64[][]
  "channel time domain": f64[][]
  "IQ": c128[]
  "RE_data": f64[]
  "IM_data": f64[]
  "Channel Freq. Resp.": c128[]
  "transmission interval [s]": f64
  "UART.status": T10
  "Received Bytes": u8[]
  "K_set": i16[]
  "M_set": i16[]
  "RM properties": T11
  "UDP receive error": string  # source out indicates the source of the error.
  "TX signal": FXP(3.14)[][]
  "RX.RM.debug counter_out": T13
  "Pilot-Betrag": UFXP(2.14)[]
  "Pilot-Phase": f64[]
  "TX byte": u8[]
  "rms value": f64
  "PSD": f64[]
  "RX Gain": UFXP(5.1)
  "RX.sync.lastWrittenRxGain": UFXP(5.1)
  "RX.modem.DEBUG.cluster_out": T4
  "ChEst.SamplesOut": u32
  "RX.sync.syncPaketsDicarded": u32
  "GFDM B": u16
  "bits per symbol": u8
  "Nof RX packets": u64
  "Nof packets wrong": u64
  "Nof packets correct": u64
  "empty elements remaining": u32
  "Nof TX Data packets": u64
  "Nof TX Dummy pakets": u64
  "Nof TX Packets": u64
  "latency": u32
  "latency value": u32
  "eptyEl_txFIFO": u32
  "number elements in queue": i32
  "loop iteration": i32
  "loop iteration_2": i32
types:
  "GFDM parameter.gtype" = cluster{"Variable: K": i32, "Variable: M": i32, "Variable: a": f64, "filter type": enum{"rc", "rect"}, "receive filter": enum{"MF", "ZF"}, "inverse FFT": bool, "Variable: b": f64, "Ncs": u16, "Ncp": u16}
  T1 = cluster{"packets in_out": u16, "samples in_out": u16, "packets out_out": u16, "samples out_out": u16, "number of invalid samples": u64, "mod first samples out": u64, "mod last samples out": u64}
  T2 = cluster{"FFT misalignment": u64, "FFT halt": u64, "FFT last sample": u64}
  T3 = cluster{"number of invalid samples": u64, "first samples out": u64, "last samples out": u64, "number of cycles": u64}
  T4 = cluster{"Element 1": T1, "Element 2": T2, "Element 3": T3}
  T5 = cluster{"Coerced Frequencies [Hz]": f64[], "Coerced LO Frequencies [Hz]": f64[], "Coerced Output Powers [dBm]": f64[], "Coerced Sample Rates [S/s]": f64[]}
  T6 = cluster{"Coerced Frequencies [Hz]": f64[], "Coerced LO Frequencies [Hz]": f64[], "Coerced Levels [dBm]": f64[], "Coerced Sample Rates [S/s]": f64[]}
  T7 = cluster{"K-1": u16, "M-1": u8, "N-1": u16, "N": u16, "Npreamble+CP+CS": u16, "Npreamble": u16, "Nw": u16, "Modulator MUX config": u64[16], "K": u16, "fft_size_log2(K)": u8, "inverse_fft": bool, "Start with preamble": bool, "Burstmode": bool, "Ncs": u16, "Ncp": u16, "N-Ncp": u16, "N+Ncp": u16, "N+Ncp+Ncs": u16, "Demodulator MUX config": u64[16], "M": u8, "DFT SIZE": FXP(6.0), "Frame length": u32, "Super frame length": u32, "Ns_all_GFDM_blocks": u32, "Ns_all_preambles": u32}
  T8 = cluster{"Preamble mu": u16, "GFDM B": u16, "Preamble K": u16, "Preamble Ncp": u16, "GFDM Ncp": u16, "GFDM M": u16, "Preamble Ncs": u16, "GFDM K": u16, "GFDM Ncs": u16, "Preamble M": u16}
  T9 = cluster{"txEnable": bool, "rxEnable": bool, "Reset": bool, "baud_count": u16, "reset frame counter": bool, "reset tx counter": bool, "reset rx counter": bool}
  T10 = cluster{"debug rxData": u8, "debug txData": u8, "debug rxData valid": bool, "tx FIFO output valid": bool, "debug txRdy": bool, "count Error": u32, "count tx [Bytes]": u32, "count rx [Byte]": u32}
  T11 = cluster{"Element 1": u16, "Element 2": u16, "Element 3": u16, "Element 4": u16}
  T12 = enum{"Data from Host", "Data from UART", "UART Loopback", "RX TX Loopback"}
  T13 = cluster{"first samples in": u16, "samples input": u16, "samples multiplexed": u16, "samples divided in blocks before multiplexer": u16, "corrected samples": u16, "samples divided in blocks after multiplexer": u16, "overflow counter_out": u16, "lost samples_out": u16, "state": u8}
  T14 = cluster{"CFO removal": bool, "ffoPiControlCte": FXP(2.17), "Pi Control": UFXP(1.15), "Analog Gain Controller": bool, "setpoint (max. amplitude)": UFXP(0.15), "numbOfBlocksBeforGainChange": u16, "Digital Gain Controller": bool, " Gain [dB]": UFXP(5.1), "permissible error [dB]": UFXP(5.1)}
  T15 = enum{"TX1 RX1 transmits and RX2 receives", "TX1 RX1 receives and RX2 is unused"}
  T16 = cluster{"set": bool, "lo lpf": bool, "cpld ": bool, "switchChannel": bool, "Destination": enum{"configRx", "configTx"}, "antenna configuration": T15, "daughterboard": enum{"sbx", "cbx", "wbx", "unknown", "ubx"}, "GainIn": UFXP(5.1), "spi address": u8}
  T17 = enum{"CAPI", "UDP or generate ", "UDP or generate over queue"}
  T18 = enum{"repeat all packets", "repeat only type 0", "do not repeat"}
  T19 = cluster{"port": u16, "ip": string, "connection": UdpNetworkConnectionRefnum, "type": u8, "id": u8}
diagram:
  case ($UseCAPIData) {
    frame True {
      w1 = no error
      w2 = UdpNetworkConnectionRefnum constant
      w3 = UdpNetworkConnectionRefnum constant
    }
    frame False {
      call "config UDP.gvi"(receive port (from vlc player)=$"UDP receive port") -> (UDP receive=w2, UDP send=w3, error out=w1)
    }
  }
  call "Reset FPGA.gvi"(USRP RIO device=$"USRP RIO device", error in=w1) -> (error out=w4, USRP RIO device out=w5)
  FPGA Open Node[ProjectItem=":NullTarget:USRP\\-Bitfile\\-0026\\.lvbitx"](RIO address=w5, error in=w4, run?=TRUE) -> (error out=w6, reference out=w7)
  call "ConfigureDevice.gvi"(Reference Frequency Source=$"Reference Frequency Source", FPGA in=w7, error out=w6, USRP RIO device=$"USRP RIO device", GFDM parameter=$"GFDM parameter", TX.Frequency [Hz]=$"TX.Frequency [Hz]", TX.Sample Rate [S/s]=$"TX.Sample Rate [S/s]", RX.Frequency [Hz]=$"RX.Frequency [Hz]", RX.Sample Rate [S/s]=$"RX.Sample Rate [S/s]", RX Power [dBm]=$"init RX Power [dBm]", TX Power [dBm]=$"init TX Power [dBm]") -> (FPGA.Interface=w8, RX Coerced Configurations=w9, TX Coerced Configurations=w10, ni usrp session 2=w11, ni usrp session=w12)
  Dynamic Fpga Interface Cast(reference in=w8, type="FPGA interface.gtype" constant) -> (reference out=w13)
  call "Configure FIFOs.gvi"(FPGA interface in=w13) -> (FPGA interface out=w14, error out=w15)
  case (w15) {
    frame No Error, Default {
      call "configFPGA.gvi"(FPGA.InterfaceIn=w14, ErrorIn=w15, GFDM Parameter=$"GFDM parameter", RM:No DC=$"RM:No DC", Use Phase Tracking=$"Use Phase Tracking", PayloadSize [Byte]=$"PayloadSize [Byte]", QAM order=$"QAM order", use frame counter=$"Add frame counter", DataType_Host=$DataType_Host) -> (ErrorOut=w19, FPGA.InterfaceOut=w20, GfdmAllParametersOut=w21, M_set=w22, K_set=w23, Fully allocated?=w24, ChennalEstimationParameterOut=w25, GFDM B out=w26, bitsPerSymbol=w27)
      call "UDPopen.gvi"(error in=w19, TestManConfig in=$"TestManConfig in") -> (TestManConfig out=w28, error out=w29)
      Property Node(instance in=w21) -> ("packet length:packet [byte]"=w30)
      Property Node(instance in=w21) -> ("packet length:payload [bytes]"=w31)
      Obtain Queue(element data type=u8[] [], max queue size=10, name="RX Data") -> (queue out=w32)
      String To Ip Address(name=$"UDP send address") -> (net address=w33)
      Obtain Queue(element data type=u8[] [], max queue size=10, name="TX Data") -> (queue out=w34)
      w35 = $"enable CRC?"
      w36 = $"Add frame counter"
      w37 = $"UDP send port"
      w38 = $"Add frame counter"
      case ($DataType_Host) {
        frame "CAPI" {
          w39 = w34
          w40 = w32
        }
        frame "UDP or generate ", Default {
          $"repeat options" <- "do not repeat"
          s1 = w19  # shift register
          while (iteration -> i1) {
            # [TX]
            disable {
              frame Enabled { }
              frame Disabled {
                case ($"simulate UDP") {
                  frame False, Default { }
                  frame True {
                    Wait[Units=Microseconds](time to wait=$"microseconds to wait")
                  }
                }
              }
            }
            call "[TX] UDP Source.gvi"(simulate=$"simulate UDP", UDP conection=w2, PayloadSize=w31, generate.dataType=$"data type") -> (DataOut=w41, UDP receive error=w42, Data available=w43)
            case (w43) {
              frame False, Default {
                w44 = s1
              }
              frame True {
                call "mod N counter with reset.gvi"(enable=TRUE, N=18446744073709551615) -> (index=w45)
                $"Nof TX Packets" <- w45
                call "[TX] prepare packet.gvi"(addFrameCounter=w36, dataIn=w41) -> (DataOut=w46)
                $"TX byte" <- w46
                Host Fifo Write Node[FifoName="Needed Resources.grsc\\TX.data in.H2T"](data=w46, error in=s1, reference in=w20) -> (empty elements remaining=w47, error out=w44)
                $"empty elements remaining" <- w47
              }
            }
            $"UDP receive error" <- w42
            $"loop iteration" <- i1
            next s1 = w44
            stop if $stop
          }
          while (iteration -> i2) {
            To Unsigned Long Integer(number=w30) -> w48
            # [RX]
            Host Fifo Read Node[FifoName="Needed Resources.grsc\\RX.Data out.T2H"](error in=w19, number of elements=w48, reference in=w20, timeout (ms)=1000) -> (data=w49, error out=w50, reference out=w51)
            case (w50) {
              frame No Error, Default {
                call "[RX] prepare packet.gvi"(dataIn=w49, packet type used?=FALSE, frame counter used?=w38) -> (DataOut=w52, packet type=w53, packet count=w54, Nof packets correct=w55, Nof packets wrong=w56, Nof packets=w57, recivedBytesWithoutCRC=w58)
                $"Received Bytes" <- w58
                call "[RX] Data Sink.gvi"(UDP send port=w37, DataIn=w52, packet type=w53, packet count=w54, UDP conection (sink)=w3, simulate UDP?=$"simulate UDP", udp ipadress=w33)
                $"Nof RX packets" <- w57
                $"Nof packets wrong" <- w56
                $"Nof packets correct" <- w55
              }
              frame Error { }
            }
            $"loop iteration_2" <- i2
            stop if $stop
          }
          w39 = w34
          w40 = w32
        }
        frame "UDP or generate over queue" {
          while {
            # [TX] dummy/test data->Queue
            call "[TX] inject dummy data to queue.gvi"(queue=w34, Nof bytes=w31, data type=$"data type_dymmy", enable=$"create dummy data")
            Get Queue Status(queue=w34) -> (# elements in queue=w59)
            $"number elements in queue" <- w59
            Wait[Units=Microseconds](time to wait=$"microseconds to wait dummy data")
            stop if $stop
          }
          while {
            # [TX] UDP->Queue
            call "[TX] inject UDP data to queue.gvi"(queu=w34, simulate udp=$"simulate UDP", UDP=w2, PayloadSize [byte]=w31, data type=$"data type") -> (UDP receive error=w60)
            $"UDP receive error" <- w60
            disable {
              frame Enabled { }
              frame Disabled {
                case ($"simulate UDP") {
                  frame False, Default { }
                  frame True {
                    Wait[Units=Microseconds](time to wait=$"microseconds to wait")
                  }
                }
              }
            }
            stop if $stop
          }
          s2 = w19  # shift register
          while (after w35) {
            Dequeue Element(error in=s2, queue=w34, timeout in ms=0) -> (element=w61, error out=w62)
            call "[TX] prepare packet.gvi"(addFrameCounter=w36, dataIn=w61) -> (DataOut=w63)
            Array Size(array=w63) -> (size(s)=w64)
            Is Not Equal To 0(x=w64) -> w65
            case (w65) {
              frame False, Default {
                w66 = w62
              }
              frame True {
                Array Index(array=w63) -> (out0[1]=w67)
                Is Equal To 0(x=w67) -> w68
                disable {
                  frame Disabled { }
                  frame Enabled {
                    Not(x=w68) -> w69
                    call "mod N counter with reset.gvi"(enable=w69, N=18446744073709551615) -> (index=w70)
                    $"Nof TX Dummy pakets" <- w70
                    call "mod N counter with reset.gvi"(enable=w68, N=18446744073709551615) -> (index=w71)
                    Add(w70, w71) -> w72
                    $"Nof TX Packets" <- w72
                    $"Nof TX Data packets" <- w71
                  }
                }
                $"TX byte" <- w63
                Host Fifo Write Node[FifoName="Needed Resources.grsc\\TX.data in.H2T"](data=w63, error in=w62, reference in=w20) -> (empty elements remaining=w73, error out=w66)
                $eptyEl_txFIFO <- w73
              }
            }
            # [TX] Queue->DMA FIFO
            next s2 = w66
            stop if $stop
          }
          while (after w28) {
            To Unsigned Long Integer(number=w30) -> w74
            # [RX]
            Host Fifo Read Node[FifoName="Needed Resources.grsc\\RX.Data out.T2H"](error in=w19, number of elements=w74, reference in=w20, timeout (ms)=1000) -> (data=w75, error out=w76, reference out=w77)
            case (w76) {
              frame No Error, Default {
                call "[RX] prepare packet.gvi"(dataIn=w75, packet type used?=TRUE, frame counter used?=w38) -> (DataOut=w78, packet type=w79, packet count=w80, Nof packets correct=w81, Nof packets wrong=w82, Nof packets=w83, recivedBytesWithoutCRC=w84)
                $"Received Bytes" <- w84
                call "[RX] Data Sink.gvi"(UDP send port=w37, DataIn=w78, packet type=w79, packet count=w80, UDP conection (sink)=w3, queue=w32, simulate UDP?=$"simulate UDP", udp ipadress=w33)
                $"Nof RX packets" <- w83
                $"Nof packets wrong" <- w82
                $"Nof packets correct" <- w81
              }
              frame Error {
                disable {
                  frame Enabled { }
                  frame Disabled {
                    Wait(time to wait=$"microseconds to wait")
                  }
                }
              }
            }
            stop if $stop
          }
          w39 = w34
          w40 = w32
        }
      }
      Release Queue(queue=w39)
      Release Queue(queue=w40)
      Property Node(instance in=w21) -> ("Modem Configuration:Super frame length"=w85)
      Property Node(instance in=w21) -> ("Preamble"=w86)
      Array Size(array=w86) -> (size(s)=w87)
      Obtain Queue(element data type=cluster{"type": u8, "data": u64[]} {all zero or empty}, error in=w19, max queue size=20, name="debug data") -> (error out=w88, queue out=w89)
      w90 = $"PayloadSize [Byte]"
      Multiply(w90, 8) -> w91
      Divide(x=w91, y=w27) -> w92
      To Unsigned Long Integer(number=w92) -> w93
      case ($readDebbugData) {
        frame False, Default { }
        frame True {
          while {
            # read data from debug fifos
            call "[TX]read debug data.gvi"(requested length=w85, timeout (ms)=10, FPGA.Interface_in=w20, Error_In=w88, queue=w89)
            call "[RX]read synch debug data.gvi"(requested length=w87, timeout (ms)=10, FPGA.Interface_in=w20, Error_In=w88, queue=w89)
            Multiply(w93, $numbOfFramesToDisplay) -> w94
            call "[RX]read demod debug 32bit data.gvi"(requested length=w94, timeout (ms)=10, FPGA.Interface_in=w20, Error_In=w88, queue=w89)
            call "[RX]read demod debug 64bit data.gvi"(requested length=w94, timeout (ms)=10, FPGA.Interface_in=w20, Error_In=w88, queue in=w89)
            Wait(time to wait=10)  # Wait (Milliseconds)
            stop if $stop
          }
        }
      }
      case ($EvaluateDebugData) {
        frame False, Default { }
        frame True {
          while {
            Wait(time to wait=10)  # Wait (Milliseconds)
            Dequeue Element(error in=w88, queue=w89, timeout in ms=10) -> (element=w95, timed out?=w96)
            Property Node(instance in=w95) -> ("data"=w97, "type"=w98)
            Select(s=w96, t=0, f=w98) -> w99
            # Evaluate debug data
            case (w99) {
              frame 0, Default { }
              frame 1 {
                call "[TX]evaluate debug data.gvi"(data=w97) -> (PSD=w100, TX signal=w101)
                Is Equal(x=$Operation, y=1) -> w102
                case (w102) {
                  frame False, Default { }
                  frame True {
                    $PSD <- w100
                    $"TX signal" <- w101
                  }
                }
              }
              frame 2 {
                Is Equal(x=$Operation, y=3) -> w103
                call "readDebugData_RxSync.gvi"(data=w97, normalize preamble?=$"normalize preamble?", parameters in=w21, Channel Length=$"Channel Length", Fully allocated?=$"Fully allocated?", TX.sync.debugType=$"TX.sync.debugOut") -> (debugGraphSync=w104, rms value=w105, Channel Freq. Resp.=w106, channel freq domain=w107, channel time domain=w108)
                case (w103) {
                  frame False, Default { }
                  frame True {
                    $debugGraphSync <- w104
                    $"rms value" <- w105
                    $"Channel Freq. Resp." <- w106
                    $"channel freq domain" <- w107
                    $"channel time domain" <- w108
                  }
                }
              }
              frame 3 {
                call "u32 array to 2.14 CFX.gvi"(data=w97) -> (Array=w109)
                To Double Precision Complex(number=w109) -> w110
                Is Equal(x=$Operation, y=0) -> w111
                Logical And(w111, $"all symbols out") -> w112
                case (w112) {
                  frame False, Default { }
                  frame True {
                    $IQ <- w110
                  }
                }
                disable {
                  frame Enabled { }
                  frame Disabled {
                    case ($"TestMan broadcasts") {
                      frame False, Default { }
                      frame True {
                        call "sendComplexData.gvi"(array_in=w110, error_in=w29, precision=2, TestMan config_in=w28, update interval_in=$"network update interval [ms]", chartName_in="IQ-Data", max number of packets=$"max number of packets") -> (TestMan config_out=w113, Error_out=w114)
                      }
                    }
                  }
                }
              }
              frame 4 {
                Split Number(x=w97) -> (high(x)=w115, low(x)=w116)
                call "Calculate Pilot Results.gvi"(received pilot array=w115) -> (Pilot-Betrag=w117, Pilot-Phase=w118)
                Is Equal(x=$Operation, y=0) -> w119
                case (w119) {
                  frame False, Default { }
                  frame True {
                    $"Pilot-Betrag" <- w117
                    $"Pilot-Phase" <- w118
                  }
                }
                call "u32 array to 2.14 CFX.gvi"(data=w116) -> (Array=w120)
                To Double Precision Complex(number=w120) -> w121
                Logical And(w119, not $"all symbols out") -> w122
                case (w122) {
                  frame False, Default { }
                  frame True {
                    $IQ <- w121
                  }
                }
                Complex To Real Imaginary(x + iy=w121) -> (x=w123, y=w124)
                Is Equal(x=$Operation, y=4) -> w125
                case (w125) {
                  frame False, Default { }
                  frame True {
                    $RE_data <- w123
                    $IM_data <- w124
                  }
                }
                case ($"TestMan broadcasts") {
                  frame False, Default { }
                  frame True {
                    call "sendComplexData.gvi"(array_in=w121, error_in=w29, precision=2, TestMan config_in=w28, update interval_in=$"network update interval [ms]", chartName_in="IQ-Data", max number of packets=$"max number of packets") -> (TestMan config_out=w126, Error_out=w127)
                  }
                }
              }
            }
            stop if $stop
          }
        }
      }
      while {
        Increment(x=w90) -> w128
        call "latencyMeasure.gvi"(packet size_in=w128, Measurement active_in=$"Measurement active_in", timeout in milliseconds_in=$"latency measurment timeout [ms]_in", repeat every [ms]=$"repeat every [ms]", queue in=w32) -> (packet valid_out=w129, packet_out=w130, latency_out=w131, latency valid_out=w132)
        case (w129) {
          frame False, Default { }
          frame True {
            Enqueue Element(element=w130, error in=w29, queue=w34)
          }
        }
        case (w132) {
          frame False, Default { }
          frame True {
            $latency <- w131
            $"latency value" <- w131
            call "sendValue.gvi"(value=w131, active=TRUE, TestManConfig out=w28, value name="latency", update interval_in=1)
          }
        }
        Wait[Units=Microseconds](time to wait=100)
        stop if $stop
      }
      call "Decode Daughterboard Names.gvi"(niUsrpRio Session=w11, error in=w15) -> (daughterboard names=w133)
      Array Index(array=w133) -> (out0[_]=w134)
      while {
        Property Node(instance in=w21)
        Property Node(instance in=w20, error in=w19) -> ("rx.number of overflows"=w135, "rx.output sample rate"=w136, "rx 1.number of IQ data overflows"=w137, "rx 0.number of IQ data overflows"=w138, "rx.samples processed"=w139, "rx.samples to acquire"=w140, "rx.state"=w141, "tx 0.number of IQ data overflows"=w142, "tx 1.number of IQ data overflows"=w143, "tx.input sample rate"=w144, "TX.modem.DEBUG.cluster_out"=w145, "tx.state"=w146, "tx.underflows"=w147, "RX.sync.sync found_out"=w148, "TX.modem.configuration_in"=w149, "RX.sync.GFDM configuration cluster"=w150, "RX.modem.DEBUG.cluster_out"=w151, "UART.status"=w152, "RM properties"=w153, "RX.RM.debug counter_out"=w154, "RX.sync.lastWrittenRxGain"=w155, "ChEst.SamplesOut"=w156, "RX.sync.syncPaketDicarded"=w157, error out=w158, instance out=w159)
        $"rx.number of overflows" <- w135
        Property Node(instance in=w25, "config:L.ch.1"=$"Channel Length", "config:L.ch.2"=$"Channel Length", "config:shiftFactorDft"=$shiftFactorReciprocal) -> (instance out=w160)
        Property Node(instance in=$"ATR.config", "switchChannel"=$"RX.switch channels", "daughterboard"=w134) -> (instance out=w161)
        call "completeSynchConfig.gvi"(GfdmConfigurationCluster=w150, syncConfigIn=$"RX.sync.config") -> (syncConfigOut=w162)
        Property Node(instance in=w159, "RX.sync.config"=w162, "TX.modem.bitshift_in"=$"TX.modem.bitshift_in", "RX.switch channels"=$"RX.switch channels", "RX.modem.bitshift_in"=$"RX.modem.bitshift_in", "RX.modem.fft.bitshift_in"=$"RX.modem.fft.bitshift_in", "RX.sync.input enable_in"=$"RX.enable", "TX.modem.trigger limit"=$"TX.modem.transmission time interval", "TX.encoder.enabled"=$"TX.enabled", "UART.control"=$"UART.control", "Data Routing"=$DataRouting_FPGA, "AGC.config"=w161, "TX.sync.preambleOrAllData"=$"TX.sync.debugOut", "RX.sync.preambleOutFifoActive"=$"RX.sync.preambleOutFifoActive", "ChEst.Parameters"=w160, "AGC.disableAGC"=$"AGC.disableAGC", "TX.switchTxChannel"=$"TX.switch Channel", "TX.modem.input shift_in"=$"TX.modem.input shift_in", "RX.forward broken crc"=$"RX.forward broken crc", "TX.Nsleep-3 (min.2)"=$"TX.Nsleep-3 (min.2)", "TX.akivateRepeatiotion"=$"TX.akivateRepeatiotion", "RX.forward repeated crc"=$"RX.forward repeated crc", error in=w158) -> (error out=w17, instance out=w16)
        disable {
          frame Enabled { }
          frame Disabled {
            call "Display Error.gvi"(type of dialog="no dialog", error in=w17) -> (description=w163)
            $"general error description" <- w163
          }
        }
        $"rx.output sample rate" <- w136
        $"rx 1.number of IQ data overflows" <- w137
        $"rx 0.number of IQ data overflows" <- w138
        $"rx.samples processed" <- w139
        $"rx.samples to acquire" <- w140
        $"rx.state" <- w141
        $"tx 0.number of IQ data overflows" <- w142
        $"tx 1.number of IQ data overflows" <- w143
        $"tx.input sample rate" <- w144
        $"TX.modem.DEBUG.cluster_out" <- w145
        $"tx.RF.state" <- w146
        $"tx.underflows" <- w147
        $"RX.sync.sync found_out" <- w148
        $"FPGA configuration" <- w149
        $"RX.sync.GFDM configuration cluster" <- w150
        $"RX.modem.DEBUG.cluster_out" <- w151
        $"UART.status" <- w152
        $"RM properties" <- w153
        $"RX.RM.debug counter_out" <- w154
        Wait(time to wait=10)
        $"RX Gain" <- w155
        $"RX.sync.lastWrittenRxGain" <- w155
        $"ChEst.SamplesOut" <- w156
        $"RX.sync.syncPaketsDicarded" <- w157
        Divide(x=$"TX.modem.transmission time interval", y=180000000) -> w164
        $"transmission interval [s]" <- w164
        stop if $stop
      }
      $M_set <- w22
      $K_set <- w23
      $"Fully allocated?" <- w24
      $"GFDM B" <- w26
      $"bits per symbol" <- w27
      call "Display Error.gvi"(type of dialog="no dialog", error in=w19) -> (description=w165)
      $"general error description" <- w165
      w18 = w12
    }
    frame Error {
      call "Display Error.gvi"(type of dialog="no dialog", error in=w15) -> (description=w166)
      $"general error description" <- w166
      w16 = w14
      w17 = w15
      w18 = w12
    }
  }
  call "stop FIFOs.gvi"(FPGA interface in=w16, Error=w17) -> (error in=w167)
  call "Close Device.gvi"(niusrprio session=w18, error in=w167) -> (error out=w168)
  disable {
    frame Enabled { }
    frame Disabled {
      call "Display Error.gvi"(type of dialog="no dialog", error in=w168) -> (description=w169)
      $"general error description" <- w169
    }
  }
  $stop <- FALSE
  case (w17) {
    frame No Error, Default { }
    frame Error {
      $stop <- FALSE
    }
  }
  $"RX Coerced Configurations" <- w9
  $"TX Coerced Configurations" <- w10
  $"enable CRC?" <- FALSE
