vi "Configure FIFOs.gvi"   [LabVIEW Communications System Design Suite 2.0.1]
inputs:
  "FPGA interface in": "FPGA interface.gtype"
  "error in": error
  "UseCAPIData": bool
outputs:
  "FPGA interface out": "FPGA interface.gtype"
  "error out": error
  "channel coefficients fifo depth": u32
diagram:
  disable {
    frame Enabled {
      w1 = $"FPGA interface in"
      w2 = $"error in"
      w3 = 100000000
    }
    frame Disabled {
      Host Fifo Configure Node[FifoName="ChennalEstimationResource.grsc\\T2H.EqualizedPayladOut"](depth=100000000, error in=$"error in", reference in=$"FPGA interface in") -> (actual depth=w3, error out=w2, reference out=w1)
    }
  }
  $"channel coefficients fifo depth" <- w3
  case ($UseCAPIData) {
    frame True {
      w4 = w1
      w5 = w3
      w6 = w2
    }
    frame False {
      # data out
      Host Fifo Configure Node[FifoName="Needed Resources.grsc\\RX.Data out.T2H"](depth=w3, error in=w2, reference in=w1) -> (actual depth=w7, error out=w8, reference out=w9)
      # data in
      Host Fifo Configure Node[FifoName="Needed Resources.grsc\\TX.data in.H2T"](depth=w7, error in=w8, reference in=w9) -> (actual depth=w5, error out=w6, reference out=w4)
    }
  }
  Host Fifo Configure Node[FifoName="Needed Resources.grsc\\RX.Preamble out"](depth=w5, error in=w6, reference in=w4) -> (actual depth=w10, error out=w11, reference out=w12)
  Host Fifo Configure Node[FifoName="Needed Resources.grsc\\RX.pulse shape in"](depth=w10, error in=w11, reference in=w12) -> (actual depth=w13, error out=w14, reference out=w15)
  Host Fifo Configure Node[FifoName="Needed Resources.grsc\\RX.Debug.Modem_64 bit samples out"](depth=w13, error in=w14, reference in=w15) -> (actual depth=w16, error out=w17, reference out=w18)
  Host Fifo Configure Node[FifoName="Needed Resources.grsc\\TX.Debug.frame out"](depth=w16, error in=w17, reference in=w18) -> (actual depth=w19, error out=w20, reference out=w21)
  disable {
    frame Enabled {
      w22 = w21
      w23 = w19
      w24 = w20
    }
    frame Disabled {
      Host Fifo Configure Node[FifoName="Needed Resources.grsc\\TX.Preamble in"](depth=w19, error in=w20, reference in=w21) -> (actual depth=w23, error out=w24, reference out=w22)
    }
  }
  Host Fifo Configure Node[FifoName="Needed Resources.grsc\\TX.pulse shape in"](depth=w23, error in=w24, reference in=w22) -> (actual depth=w25, error out=w26, reference out=w27)
  Host Fifo Configure Node[FifoName="Needed Resources.grsc\\TX.Window in"](depth=w25, error in=w26, reference in=w27) -> (actual depth=w28, error out=w29, reference out=w30)
  Host Fifo Configure Node[FifoName="Updater Resources.grsc\\download"](depth=w28, error in=w29, reference in=w30) -> (error out=w31, reference out=w32)
  call "stop FIFOs.gvi"(FPGA interface in=w32, Error=w31, UseCAPIData=$UseCAPIData) -> (FPGA interface out=w33, error in=w34)
  disable {
    frame Enabled {
      w35 = w34
      w36 = w33
    }
    frame Disabled {
      Host Fifo Start Node[FifoName="ChennalEstimationResource.grsc\\T2H.EqualizedPayladOut"](error in=w34, reference in=w33) -> (error out=w35, reference out=w36)
    }
  }
  case ($UseCAPIData) {
    frame True {
      w37 = w36
      w38 = w35
    }
    frame False {
      # data out
      Host Fifo Start Node[FifoName="Needed Resources.grsc\\RX.Data out.T2H"](error in=w35, reference in=w36) -> (error out=w39, reference out=w40)
      # data in
      Host Fifo Start Node[FifoName="Needed Resources.grsc\\TX.data in.H2T"](error in=w39, reference in=w40) -> (error out=w38, reference out=w37)
    }
  }
  Host Fifo Start Node[FifoName="Needed Resources.grsc\\RX.Preamble out"](error in=w38, reference in=w37) -> (error out=w41, reference out=w42)
  Host Fifo Start Node[FifoName="Needed Resources.grsc\\RX.pulse shape in"](error in=w41, reference in=w42) -> (error out=w43, reference out=w44)
  Host Fifo Start Node[FifoName="Needed Resources.grsc\\RX.Debug.Modem_64 bit samples out"](error in=w43, reference in=w44) -> (error out=w45, reference out=w46)
  Host Fifo Start Node[FifoName="Needed Resources.grsc\\TX.Debug.frame out"](error in=w45, reference in=w46) -> (error out=w47, reference out=w48)
  disable {
    frame Enabled {
      w49 = w48
      w50 = w47
    }
    frame Disabled {
      Host Fifo Start Node[FifoName="Needed Resources.grsc\\TX.Preamble in"](error in=w47, reference in=w48) -> (error out=w50, reference out=w49)
    }
  }
  Host Fifo Start Node[FifoName="Needed Resources.grsc\\TX.pulse shape in"](error in=w50, reference in=w49) -> (error out=w51, reference out=w52)
  Host Fifo Start Node[FifoName="Needed Resources.grsc\\TX.Window in"](error in=w51, reference in=w52) -> (error out=w53, reference out=w54)
  Host Fifo Start Node[FifoName="Updater Resources.grsc\\download"](error in=w53, reference in=w54) -> (error out=w55, reference out=w56)
  # data out
  case ($UseCAPIData) {
    frame True {
      w57 = w56
      w58 = w55
    }
    frame False {
      Host Fifo Read Node[FifoName="Needed Resources.grsc\\RX.Data out.T2H"](error in=w55, number of elements=0, reference in=w56) -> (elements remaining=w59, error out=w60, reference out=w61)
      Host Fifo Read Node[FifoName="Needed Resources.grsc\\RX.Data out.T2H"](error in=w60, number of elements=w59, reference in=w61) -> (error out=w58, reference out=w57)
    }
  }
  Host Fifo Read Node[FifoName="Needed Resources.grsc\\RX.Debug.Modem_64 bit samples out"](error in=w58, number of elements=0, reference in=w57) -> (elements remaining=w62, error out=w63, reference out=w64)
  Host Fifo Read Node[FifoName="Needed Resources.grsc\\RX.Debug.Modem_64 bit samples out"](error in=w63, number of elements=w62, reference in=w64) -> (error out=w65, reference out=w66)
  Host Fifo Read Node[FifoName="Needed Resources.grsc\\RX.Preamble out"](error in=w65, number of elements=0, reference in=w66) -> (elements remaining=w67, error out=w68, reference out=w69)
  Host Fifo Read Node[FifoName="Needed Resources.grsc\\RX.Preamble out"](error in=w68, number of elements=w67, reference in=w69) -> (error out=w70, reference out=w71)
  Host Fifo Read Node[FifoName="Needed Resources.grsc\\TX.Debug.frame out"](error in=w70, number of elements=0, reference in=w71) -> (elements remaining=w72, error out=w73, reference out=w74)
  Host Fifo Read Node[FifoName="Needed Resources.grsc\\TX.Debug.frame out"](error in=w73, number of elements=w72, reference in=w74) -> (error out=w75, reference out=w76)
  $"FPGA interface out" <- w76
  $"error out" <- w75
