vi "stop FIFOs.gvi"   [LabVIEW Communications System Design Suite 2.0.1]
inputs:
  "FPGA interface in": "FPGA interface.gtype"
  "Error": error
  "UseCAPIData": bool
outputs:
  "FPGA interface out": "FPGA interface.gtype"
  "error in": error
diagram:
  Host Fifo Stop Node[FifoName="Needed Resources.grsc\\RX.channel Coefficients in"](error in=$Error, reference in=$"FPGA interface in") -> (error out=w1, reference out=w2)
  case ($UseCAPIData) {
    frame True {
      w3 = w2
      w4 = w1
    }
    frame False {
      # data out
      Host Fifo Stop Node[FifoName="Needed Resources.grsc\\RX.Data out.T2H"](error in=w1, reference in=w2) -> (error out=w5, reference out=w6)
      # data in
      Host Fifo Stop Node[FifoName="Needed Resources.grsc\\TX.data in.H2T"](error in=w5, reference in=w6) -> (error out=w4, reference out=w3)
    }
  }
  Host Fifo Stop Node[FifoName="Needed Resources.grsc\\RX.Preamble out"](error in=w4, reference in=w3) -> (error out=w7, reference out=w8)
  Host Fifo Stop Node[FifoName="Needed Resources.grsc\\RX.pulse shape in"](error in=w7, reference in=w8) -> (error out=w9, reference out=w10)
  Host Fifo Stop Node[FifoName="Needed Resources.grsc\\RX.sync.correlation metric"](error in=w9, reference in=w10) -> (error out=w11, reference out=w12)
  Host Fifo Stop Node[FifoName="Needed Resources.grsc\\RX.Debug.Modem_64 bit samples out"](error in=w11, reference in=w12) -> (error out=w13, reference out=w14)
  Host Fifo Stop Node[FifoName="Needed Resources.grsc\\TX.Debug.frame out"](error in=w13, reference in=w14) -> (error out=w15, reference out=w16)
  Host Fifo Stop Node[FifoName="Needed Resources.grsc\\TX.Preamble in"](error in=w15, reference in=w16) -> (error out=w17, reference out=w18)
  Host Fifo Stop Node[FifoName="Needed Resources.grsc\\TX.pulse shape in"](error in=w17, reference in=w18) -> (error out=w19, reference out=w20)
  Host Fifo Stop Node[FifoName="Needed Resources.grsc\\TX.Window in"](error in=w19, reference in=w20) -> (error out=w21, reference out=w22)
  Host Fifo Stop Node[FifoName="Updater Resources.grsc\\download"](error in=w21, reference in=w22) -> (error out=w23, reference out=w24)
  $"FPGA interface out" <- w24
  $"error in" <- w23
