vi "create bytes.gvi"   [LabVIEW Communications System Design Suite 2.0.1]
inputs:
  "Modem Configuration:N": u16
  "Random data?": bool
outputs:
  "input bit stream": u8[]
diagram:
  Divide(x=$"Modem Configuration:N", y=8) -> w1
  for (N = w1) (iteration -> i1) {
    Random Number() -> (number (0 to 1)=w3)
    Multiply(w3, 255) -> w4
    Select(s=$"Random data?", t=w4, f=i1) -> w5
    To Unsigned Byte Integer(number=w5) -> w6
    append w6 to w2
  }
  $"input bit stream" <- w2
