vi "generate pulse shape.gvi"   [LabVIEW Communications System Design Suite 2.0.1]
inputs:
  "GFDM parameter": "GFDM parameter.gtype"
  "Norm filters": bool
outputs:
  "pulse shaping filter g": c128[]
  "receiver filter gamma": c128[]
  "GFDM parameter out": "GFDM parameter.gtype"
  "pulse shape filter U64": u64[]
  "receive filter u64": u64[]
panel indicators:
  "Filters - absolute values": f64[][]
types:
  "GFDM parameter.gtype" = cluster{"Variable: K": i32, "Variable: M": i32, "Variable: a": f64, "filter type": enum{"rc", "rect"}, "receive filter": enum{"MF", "ZF"}, "inverse FFT": bool, "Variable: b": f64, "Ncs": u16, "Ncp": u16}
diagram:
  Property Node(instance in=$"GFDM parameter") -> ("filter type"=w1, "Variable: a"=w2, "Variable: K"=w3, "Variable: M"=w4, "receive filter"=w5, instance out=w6)
  case (w1) {
    frame "rect" {
      Math Node("K"=w3, "M"=w4, "a"=w2) -> ("g"=w7)
      ~~~
      g = cat(1, ones(K/2,1), zeros((M-1)*K,1),ones(K/2,1));
      ~~~
    }
    frame "rc", Default {
      Math Node("K"=w3, "M"=w4, "a"=w2) -> ("g"=w7)
      ~~~
      [ g, t ] = rc( a, K, M, 'freq', false );
      %g = fftshift(g);
      ~~~
    }
  }
  Add Array Elements(numeric array=w8) -> (sum=w9)
  Multiply(w3, w4) -> w10
  case (w5) {
    frame "MF", Default {
      Complex Conjugate(x + iy=w12) -> w13
      Reverse 1D Array(array=w13) -> (reversed array=w14)
      Rotate 1D Array(array=w14, n=1) -> (array (last n elements first)=w11)
    }
    frame "ZF" {
      Math Node("K"=w3, "g"=w12, "M"=w4, "N"=w10) -> ("gd"=w11)
      ~~~
      % employ simplified algorithm for calculation of the canonical dual
      % gabor window in case of critical sampling.
      gm = reshape(g, K, M);
      Gm = fft(gm, [], 2);
      iGm = 1 ./ conj(Gm);
      gmd = ifft(iGm, [], 2);
      gd = reshape(gmd, N, 1) / K;
      ~~~
    }
  }
  Divide(x=w7, y=w15) -> w12
  for {
    w16 = each element of w12
    call "cfx_to_u64.gvi"(input=w16) -> (output=w18)
    append w18 to w17
  }
  $"pulse shape filter U64" <- w17
  $"GFDM parameter out" <- w6
  # Proper scaling
  Square(x=w7) -> w8
  Square Root(x=w9) -> w15
  Not(x=$"Norm filters") -> w19
  call "norm CFX.gvi"(Input=w12) -> (Output=w20)
  Select(s=w19, t=w12, f=w20) -> w21
  $"pulse shaping filter g" <- w21
  Build Array(w12, w11) -> w22
  Absolute Value(x=w22) -> w23
  $"Filters - absolute values" <- w23
  call "norm CFX.gvi"(Input=w11) -> (Output=w24)
  Select(s=w19, t=w11, f=w24) -> w25
  $"receiver filter gamma" <- w25
  for {
    w26 = each element of w11
    call "cfx_to_u64.gvi"(input=w26) -> (output=w28)
    append w28 to w27
  }
  $"receive filter u64" <- w27
