vi "calculate psd.gvi"   [LabVIEW NXG]
inputs:
  "time signal x": c128[]
outputs:
  "element": f64[]
diagram:
  Array Size(array=$"time signal x") -> (size(s)=w1)
  Multiply(w1, 4) -> w2
  call "Complex FFT.gvi"(x=$"time signal x", FFT size=w2) -> (FFT {x}=w3)
  Absolute Value(x=w3) -> w4
  Logarithm Base 10(x=w4) -> w5
  Multiply(20, w5) -> w6
  $element <- w6
