vi "ImportTxtFileToComplex_Preamble.gvi"   [LabVIEW Communications System Design Suite 2.0.1]
outputs:
  "data": c128[]
panel indicators:
  "Raw Comma-Separated Data": string
  "File Save Path": path
  "Table of data": string[][]
  "Graph of Data (real)": f64[]
  "Graph of Data (imaginary)": f64[]
diagram:
  w1 = path "C:\\git\\IPP16_SISO_PHY\\demos\\IPP16\\Host\\preamble.txt"
  # The Read from Text File function will read the contents of a text file and return them as a string. The Spreadsheet String To Array function converts that string into a 2D array of strings,
  # using commas as column separators, and line feeds as row separators. The first column of timestamps is pulled out, and the remaining data is displayed in the Graph of Data.
  $"File Save Path" <- w1
  Read From Text File(file (use dialog)=w1) -> (error out=w2, text=w3)
  $"Raw Comma-Separated Data" <- w3
  call "Simple Error Handler.gvi"(error in=w2) -> (error out=w4)
  Spreadsheet String To Array(array type=string[][] [], delimiter=",", format string="%f", spreadsheet string=w3) -> (array=w5)
  # First column (real)
  Array Index(array=w5) -> (out0[_, 0]=w6)
  Floating Point String To Number(string=w6, use system decimal point (T)=FALSE) -> (number=w7)
  # Second column (imaginary)
  Array Index(array=w5) -> (out0[_, 1]=w8)
  # File read/write performance is dependent upon the size of the data written to disk.  This optimum "chunk" size will depend upon your operating system and disk block size.
  # For example, in Windows, reading or writing in 65,000 byte chunks will often optimize performance.
  Floating Point String To Number(string=w8, use system decimal point (T)=FALSE) -> (number=w9)
  Real And Imaginary To Complex(x=w7, y=w9) -> w10
  case (w4) {
    frame No Error, Default {
      $"Table of data" <- w5
      $data <- w10
      Complex To Real Imaginary(x + iy=w10) -> (x=w11, y=w12)
      $"Graph of Data (real)" <- w11
      $"Graph of Data (imaginary)" <- w12
    }
    frame Error {
      # Do not display the data if an error occurred
      # when reading the file
    }
  }
