vi "scale Kset.gvi"   [LabVIEW Communications System Design Suite 2.0.1]
inputs:
  "K": u16
  "K preamble_in": i32 = 64
  "Kset_in": u8[]
outputs:
  "K preamble_out": i32
  "scale": i32
  "Kset_out": i32[]
panel indicators:
  "preamble subcarrier mapping": u8[][]
diagram:
  $"K preamble_out" <- $"K preamble_in"
  Divide(x=$K, y=$"K preamble_in") -> w1
  To Long Integer(number=w1) -> w2
  Is Equal(x=1, y=w2) -> w3
  case (w3) {
    frame True {
      # equal: do nothing
      w4 = w2
      w5 = $Kset_in
    }
    frame False {
      Is Greater(x=w2, y=1) -> w6
      case (w6) {
        frame False, Default {
          # up sampling
          w7 = error {"status"=TRUE, "code"=123456789, "source"="!Error: Preamble scaling not implemented!"}
          call "Display Error.gvi"(error in=w7)
          w4 = w2
          w5 = i32[] []
        }
        frame True {
          # downsampling - Preamble smaller than data
          for (N = $K) (iteration -> i1) {
            Quotient And Remainder(x=i1, y=w2) -> (floor(x/y)=w10)
            Build Array(i1, w10) -> w11
            append w11 to w8
            append w10 to w9
          }
          $"preamble subcarrier mapping" <- w8
          for {
            w12 = each element of $Kset_in
            Array Index(array=w9) -> (out0[w12]=w14)
            append w14 to w13
          }
          for (iteration -> i2) {
            w15 = each element of w13
            Search 1D Array(1D array=w13, element=w15) -> (index of element=w16)
            Is Less(x=w16, y=i2) -> w17
            append w15 to w5 if w17
          }
          w4 = w2
        }
      }
    }
  }
  $scale <- w4
  $Kset_out <- w5
