vi "CP+CS.gvi"   [LabVIEW NXG]
inputs:
  "data in": c128[]
  "Ncp": i32
  "N-Ncp": i32
  "Ncs": i32
outputs:
  "data out": c128[]
diagram:
  Array Subset(array=$"data in", index0=$"N-Ncp", length0=$Ncp) -> w1
  Array Subset(array=$"data in", index0=0, length0=$Ncs) -> w2
  Build Array[ConcatenateInputs=True](w1, $"data in", w2) -> w3
  $"data out" <- w3
