vi "UDP read.gvi"   [LabVIEW Communications System Design Suite 2.0.1]
inputs:
  "UDP connection": UdpNetworkConnectionRefnum
  "Error": error
outputs:
  "receive FIFO full": bool
  "data out": u8[]
  "UDP receive error": string  # source out indicates the source of the error.
  "error out": error
diagram:
  w1 = 65535  # maximum UDP packet size
  Udp Read I Pv 6 Binary(connection ID=$"UDP connection", error in=$Error, max size=w1) -> (data out=w2, error out=w3)
  call "Clear Errors.gvi"(specific error code to clear=113, error in=w3) -> (specific error cleared?=w4, error out=w5)
  $"receive FIFO full" <- w4
  call "Clear Errors.gvi"(specific error code to clear=56, error in=w5) -> (error out=w6)
  call "Clear Errors.gvi"(specific error code to clear=66, error in=w6) -> (error out=w7)
  call "Clear Errors.gvi"(specific error code to clear=1, error in=w7) -> (error out=w8)
  $"error out" <- w8
  $"data out" <- w2
  call "Display Error.gvi"(type of dialog="no dialog", error in=w3) -> (description=w9)
  $"UDP receive error" <- w9
