vi "UDP send.gvi"   [LabVIEW Communications System Design Suite 2.0.1]
inputs:
  "UDP send.port or service name": u16
  "UDP connection": UdpNetworkConnectionRefnum
  "dataIn": u8[]
  "ErrorIn": error
  "adress": u32 = 2130710000
outputs:
  "ErrorOut": error
diagram:
  Udp Write Binary(address=$adress, connection ID=$"UDP connection", data in=$dataIn, error in=$ErrorIn, port or service name=$"UDP send.port or service name") -> (error out=w1)
  call "Clear Errors.gvi"(specific error code to clear=1, error in=w1) -> (error out=w2)
  call "Clear Errors.gvi"(specific error code to clear=55, error in=w2) -> (error out=w3)
  $ErrorOut <- w3
